# Grasshopper definition 人流模拟.gh (Grasshopper 1.0.5)
# plug-ins: Shortest Walk in Gh, ElkGHComponents

number_slider = Slider(30, range=0..1000)
pt = Point()

path = FilePath("E:\010101.osm")
loc = Location(FilePathText=path)  # -> OSMPointData, OSMFile, LongitudeDomain, LatitudeDomain
osm = OSMData(OSMPointData=loc.OSMPointData, OSMFilePath=loc.OSMFile, Feature="highway", Generate3d=False, IndividualOutputs=False)  # -> Ways, FeatureKey
scale = Scale(Geometry=osm.Ways, Center=Point(0, 0, 0), Factor=Slider(0.0001, range=0..0.0001))  # -> Geometry, Transform
prune = PruneTree(Tree=scale.Geometry, Minimum=Slider(2, range=0..10), Maximum=0)
pline = PolyLine(Vertices=prune, Closed=False)

series = Series(Start=number_slider, Step=number_slider, Count=Slider(6, range=0..10))
cir = Circle(Plane=graft(pt), Radius=series)  # -> graft(Circle)
陆地范围 = Curve(<curve referenced from the Rhino model>)
rint = RegionIntersection(CurvesA=陆地范围, CurvesB=cir)  # -> simplify(Result)
path_mapper = PathMapper(rint, source="{a;b}", target="{b}")
boundary = BoundarySurfaces(Edges=path_mapper)
popgeo = PopulateGeometry(Geometry=boundary, Count=Slider(9, range=0..10), Seed=1)  # -> flatten(Population)
popgeo_2 = PopulateGeometry(Geometry=boundary, Count=Slider(10, range=0..10), Seed=Slider(12, range=0..100))  # -> flatten(Population)
cp = ClosestPoint(Point=popgeo, Cloud=popgeo_2)  # -> ClosestPoint, CPIndex, Distance
jitter = Jitter(List=cp.ClosestPoint, Jitter=Slider(0.01, range=0..0.01), Seed=2)  # -> Values, Indices
ln = Line(StartPoint=popgeo, EndPoint=jitter.Values)
crv = Curve()
shortwalk = ShortestWalk(Curves=crv, WantedPath=ln)  # -> ShortestWalk, Succession, Direction, Length
crv_2 = Curve(shortwalk.ShortestWalk)
redpline = Reduce(Polyline=crv_2, Tolerance=Slider(4, range=0..100))  # -> Polyline, Reduction
cp_2 = ControlPoints(Curve=redpline.Polyline)  # -> Points, Weights, Knots
number_slider_2 = Slider(3, range=0..10)
pdecon = Deconstruct(Point=cp_2.Points)  # -> XComponent, YComponent, ZComponent
lng = ListLength(List=flatten(pdecon.XComponent))
lng_2 = ListLength(List=flatten(pdecon.YComponent))
dom = ConstructDomain(DomainStart=expr("-x", number_slider_2), DomainEnd=number_slider_2)
random = Random(Range=dom, Number=lng_2, Seed=Slider(5, range=0..10))
random_2 = Random(Range=dom, Number=lng, Seed=2)
unflatten = UnflattenTree(Tree=random, Guide=pdecon.YComponent)
unflatten_2 = UnflattenTree(Tree=random_2, Guide=pdecon.XComponent)
addition = Addition(A=unflatten, B=pdecon.YComponent)
addition_2 = Addition(A=unflatten_2, B=pdecon.XComponent)
pt_2 = ConstructPoint(XCoordinate=addition_2, YCoordinate=addition, ZCoordinate=0)
pline_2 = PolyLine(Vertices=pt_2, Closed=False)
